# Grasshopper definition turtle_slice.gh (Grasshopper 1.0.7)

radius_bottom = Slider(6, range=3..100)
radius_mid = Slider(15, range=3..100)
radius_top = Slider(13, range=3..100)
height = Slider(72, range=3..100)
facets = Slider(7, range=3..20)
python = GhPythonScript(facets=facets, height=height, radius_top=radius_top, radius_mid=radius_mid, radius_bottom=radius_bottom)  # -> out, points, polygons, curves; inputs facets: Int32
# ---------- python: Python ----------
__author__ = "Leah"

import rhinoscriptsyntax as rs
import math

def polyPoints (z, r):
    points = []
    for i in range (0,facets+1):
        angle = i*360/facets
        x = r*math.cos(math.radians(angle))
        y = r*math.sin(math.radians(angle))
        points.append(rs.CreatePoint(x,y,z))
    return points
    
def polygon(z, r):
    points = polyPoints(z,r)
    polygon = rs.AddPolyline(points)
    return polygon

def curvePoly(z, r):
    points = polyPoints(z,r)
    curve = rs.AddCurve(points,2)
    return curve

polygons = []
polygons.append(polygon(0,radius_bottom))
polygons.append(polygon(height/2,radius_mid))
polygons.append(polygon(height,radius_top))

curves = []
curves.append(curvePoly(0,radius_bottom))
curves.append(curvePoly(height/2,radius_mid))
curves.append(curvePoly(height,radius_top))

    
def cosPoints(z,in_r,a,b):
    points = []
    for i in range (0,360+1):
        r = in_r+a+a*math.cos(math.radians(i)*b)
        x = r*math.cos(math.radians(i))
        y = r*math.sin(math.radians(i))
        points.append(rs.CreatePoint(x,y,z))
    return points

def cosPoly(z,in_r,a,b):
    points = cosPoints(z,in_r,a,b)
    curve = rs.AddCurve(points)
    curve = rs.CloseCurve(curve,1)
    return curve
    
    
curves = []
curves.append(cosPoly(0,radius_bottom,5,5))
curves.append(cosPoly(height/2,radius_mid,5,10))
curves.append(cosPoly(height,radius_top,5,5))
# ---------- end python ----------
panel = Panel(python.out)
loft = Loft(Curves=python.curves, Options={Adjust=False, Closed=False, LoftEnds=0, LoftSimp=0, LoftType=0, Rebuild=10, Refit=0.01})
cap = CapHoles(Brep=loft)
python_2 = GhPythonScript(shape=cap)  # -> out, lines; inputs shape: Brep
# ---------- python_2: Python ----------
# code required so that library reloads appropriately
# must be above other import statements
import sys
to_delete = list()
for module in sys.modules:
    if "extruder_turtle" in module:
      to_delete.append(module)
for module in to_delete:
    sys.modules.pop(module)
    
import rhinoscriptsyntax as rs
import extruder_turtle
from extruder_turtle import *
import turtle_utilities as tu

reload(extruder_turtle)

t = ExtruderTurtle()
t.setup(x=0, y=0, z=0.0, printer = "eazao")
tu.slice_with_turtle(t,shape)
lines = t.get_lines()
# ---------- end python_2 ----------
